# Requirement set req_testt (R2021a)

## 1 [R1] Emergency status
Battery emergency status

### 1.1 [R1.1] Emer battery False
Automatic emergency is enabling (batteryOk=false) when one or more of the following are met:
* Battery temperature (battery_temp>=x)
* Battery Current (A) (battery_current>=y)
* Voltage Level (V) (battery_voltage> =z)

#### 1.1.1 [R1.1.1] battery_temp
Automatic emergency is enabling (batteryOk=false)this condition are met Battery temperature (battery_temp>=x):

#### 1.1.2 [R1.1.2] battery_current
Automatic emergency is enabling (batteryOk=false)this condition are met Battery temperature (battery_current>=x):

#### 1.1.3 [R1.1.3] battery_voltage
Automatic emergency is enabling (batteryOk=false)this condition are met Battery temperature (battery_voltage>=x):

### 1.2 [R1.2] Emer battery True
Automatic emergency is enabling (batteryOk=True) when one or more of the following are met:
* Battery temperature (battery_temp<=x)
* Battery Current (A) (battery_current<=y)
* Voltage Level (V) (battery_voltage<=z)